# Grasshopper definition 181116_Python class 1.gh (Grasshopper 1.0.7)
# plug-ins: Bifocals

curve = Curve([<curve referenced from the Rhino model> x2])
number_slider = Slider(20, range=0..20)
# Pablo Anastacio Mora Chatski
# pmora1990@gmail.com
# www.pablomora.xyz
# www.issuu.com/pablomorachatski
list_item = ListItem(List=curve, Index=Slider(1, range=0..1), Wrap=True)
list_item_2 = ListItem(List=curve, Index=Slider(0, range=0..1), Wrap=True)
divide_curve = DivideCurve(Curve=list_item_2, Count=number_slider, Kinks=False)  # -> Points, Tangents, Parameters
divide_curve_2 = DivideCurve(Curve=list_item, Count=number_slider, Kinks=False)  # -> Points, Tangents, Parameters
line = Line(StartPoint=divide_curve.Points, EndPoint=divide_curve_2.Points)
loft = Loft(Curves=line, Options={Adjust=False, Closed=False, LoftEnds=0, LoftSimp=0, LoftType=0, Rebuild=10, Refit=0.01})
colour_picker = ColourPicker(PickedColour=RGB(43, 198, 44))
geometry = Geometry(loft)
custom_preview = CustomPreview(Geometry=geometry, Material=colour_picker)
ghpython_script = GhPythonScript()  # -> Out, A
